# Grasshopper definition Opportunity Landing Site.gh (Grasshopper 1.0.8)

# ----
# INPUT: Site Mesh & Origin point
mesh = Mesh(<mesh referenced from the Rhino model>)
point = Point(<point referenced from the Rhino model>)

python_3_script = Python3Script(terrain_mesh=mesh, seed_point=point)  # -> A, B; inputs terrain_mesh: Mesh, seed_point: Point3d
# ---------- python_3_script: Python ----------
"""
STAGE E — FINAL PRODUCTION SIMULATION
- Runs full growth cycle (147 modules)
- Uses validated terrain and scale settings
"""
import Rhino.Geometry as rg
import math
import random

# ------------------------------------------------
# 1. SETUP
# ------------------------------------------------
terrain_mesh.Normals.ComputeNormals()
mp = terrain_mesh.ClosestMeshPoint(seed_point, 1000000.0)

if mp: 
    current = mp.Point
else:
    current = seed_point # Fallback

modules = [current]
iterations = [0]

# ------------------------------------------------
# 2. PARAMETERS (Optimized for Opportunity Site)
# ------------------------------------------------
sun_vec = rg.Vector3d(0, -3, .5) # Sun from South-West
sun_vec.Unitize()

max_slope_deg = 30.0  # Strict safety limit
min_dist = 3.0        # Module spacing
step_size = 3.5       # Arm length
max_modules = 147      # Carrying Capacity

dirs = []
for i in range(6):
    a = math.radians(i*60)
    dirs.append(rg.Vector3d(math.cos(a)*step_size, math.sin(a)*step_size, 0))

print("Growth started...")

# ------------------------------------------------
# 3. GROWTH LOOP
# ------------------------------------------------
for i in range(1, max_modules + 1):
    
    candidates = []
    
    # Check all 6 hex directions
    for d in dirs:
        test_pt = rg.Point3d(current)
        test_pt.Transform(rg.Transform.Translation(d))
        
        # Project to Mesh
        mp_check = terrain_mesh.ClosestMeshPoint(test_pt, 1000.0)
        
        if mp_check:
            cand_pt = mp_check.Point
            
            # RULE 1: SLOPE
            normal = terrain_mesh.NormalAt(mp_check)
            slope_rad = rg.Vector3d.VectorAngle(normal, rg.Vector3d.ZAxis)
            if math.degrees(slope_rad) > max_slope_deg:
                continue 
            
            # RULE 2: COLLISION
            collision = False
            for existing in modules:
                if cand_pt.DistanceTo(existing) < (min_dist - 0.1):
                    collision = True
                    break
            if collision: continue
                
            candidates.append(cand_pt)

    # BRANCHING (If stuck, go back)
    if not candidates:
        current = random.choice(modules)
        continue

    # RULE 3: SUN OPTIMIZATION
    best_cand = None
    best_score = -999.0

    for cand in candidates:
        growth_dir = cand - current
        growth_dir.Unitize()
        score = growth_dir * sun_vec
        
        if score > best_score:
            best_score = score
            best_cand = cand

    if best_cand:
        modules.append(best_cand)
        iterations.append(i)
        current = best_cand

print("Simulation Complete. Habitat size: {} modules.".format(len(modules)))

# OUTPUTS
A = modules
# ---------- end python_3_script ----------

# ----
# OUTPUT
number_slider = Slider(1, range=0..1)
number_slider_2 = Slider(0.01, range=0..0.01)
panel = Panel(python_3_script.A)
sphere = Sphere(Base=python_3_script.A, Radius=number_slider)
custom_preview = CustomPreview(Geometry=sphere, Material=ColourSwatch(SwatchColor=RGB(255, 0, 0)))

point_2 = Point(Point(0, 0, 0))

# ----
# Module Geometry
number_slider_3 = Slider(5, range=0..10)
xy_plane = XYPlane(Origin=point_2)
unit_z = UnitZ(Factor=number_slider_3)
polygon = Polygon(Plane=xy_plane, Radius=Slider(3.5, range=0..10), Segments=Slider(6, range=0..10), FilletRadius=0)  # -> Polygon, Length
amplitude = Amplitude(Vector=unit_z, Amplitude=Slider(2, range=0..10))
extrude = Extrude(Base=polygon.Polygon, Direction=amplitude)
cap_holes = CapHoles(Brep=extrude)
